# Dynamo graph AI constructor test - save.dyn (Dynamo 1.3.0.875)

# group: Constructor
code_block = CodeBlock { 1..10; 1..100; }
simpleLinearRegression = AI.Algorithms.Regression.SimpleLinearRegression.SimpleLinearRegression(code_block.out0, code_block.out0)
code_block_2 = CodeBlock { "TestMachine #1"; "simple machine"; }
file_path = Filename(".\AI constructor test.json")

# group: Build machine
machine = AI.Machine.Machine(simpleLinearRegression, code_block_2.out0, code_block_2.out1)

# group: Inspect
GUID = AI.Machine.GUID(machine)
name = AI.Machine.Name(machine)
getAlgorithm = AI.Machine.GetAlgorithm(machine)
name_2 = AI.Algorithms.Regression.SimpleLinearRegression.Name(getAlgorithm)
isTrainingDataLoaded = AI.Algorithms.Regression.SimpleLinearRegression.IsTrainingDataLoaded(getAlgorithm)

# group: IO
code_block_3 = CodeBlock(machine=machine) { machine; }
directoryName = FilePath.DirectoryName(file_path)
string = StringInput("AI IO test - Simple Linear Regression.json")
combine = FilePath.Combine(directoryName, string)
save = AI.Machine.Save(code_block_3, combine)
